# Dynamo graph 2-Overkill for Revit - Limpar avisos de limites de áreas sobrepostas usando o Dynamo.dyn (Dynamo 2.13.1.3887)
# packages: Bang! 2021.4.3, tstngwtrs-GroupCurves 2.0.0, spring nodes 210.1.1, Clockwork for Dynamo 1.x 1.34.0, archi-lab.net 2024.217.1024, DynaMEP 2.0.1, Rhythm 2024.3.1

# group: 1-Aviso de filtro para obter a geometria da linha de separação da área ofensiva
all_warnings_of_type = WarningsOfType("No warnings in this model.")

failingElements = RevitModel.Warning.FailingElements(warning=all_warnings_of_type)

# group (continued): 1-Aviso de filtro para obter a geometria da linha de separação da área ofensiva
flatten = List.Flatten(list=failingElements)
uniqueItems = List.UniqueItems(list=flatten)

# group: 2-Excluir curvas não ortogonais
getLocation = Element.GetLocation(element=uniqueItems)
type = Object.Type(object=getLocation)
code_block = CodeBlock { "linha"; }
contains = String.Contains(string=type, searchFor=code_block)
filterByBoolMask = List.FilterByBoolMask(list=uniqueItems, mask=contains)

ʳʰʸᵗʰᵐ_elements_viewfinder = Rhythm.Revit.Elements.Elements.ViewFinder(element=filterByBoolMask.in)

# group: 3-Curvas do modelo gorup por esquema de área
flatten_2 = List.Flatten(list=ʳʰʸᵗʰᵐ_elements_viewfinder)
code_block_2 = CodeBlock { "Familia"; "Tipo nome"; }
getParameterValueByName = Element.GetParameterValueByName(element=flatten_2, parameterName=code_block_2.out0)
getParameterValueByName_2 = Element.GetParameterValueByName(element=getParameterValueByName, parameterName=code_block_2.out1)
groupByKey = List.GroupByKey(list=filterByBoolMask.in, keys=getParameterValueByName_2)
uniqueItems_2 = List.UniqueItems(list=getParameterValueByName)

# group: 4-Agrupar linhas por esquema de área e orientação
getLocation_2 = Element.GetLocation(element=groupByKey.groups)
code_block_3 = CodeBlock { 0.1; }
tangentAtParameter = Curve.TangentAtParameter(curve=getLocation_2, param=code_block_3)
XAxis = Vector.XAxis()
dot = Vector.Dot(vector=tangentAtParameter, vec=XAxis)
abs = Math.Abs(number=dot)
code_block_4 = CodeBlock { 3; }
round = Math.Round(number=abs, digits=code_block_4)
groupByKey_2 = List.GroupByKey(list=getLocation_2, keys=round)

# group: 6-Obter novas curvas de limite de área
groupCurves = Custom[tstngwtrs.GroupCurves](curves=groupByKey_2.groups@@L1)  # package tstngwtrs-GroupCurves; Group connected curves from a list of scattered curves. Each resulting curve groups could be combined to form Polycurves and then Surfaces, if the loop is closed
code_block_5 = CodeBlock { [0.1]; }
pointAtParameter = Curve.PointAtParameter(curve=groupCurves@@L1, param=code_block_5)
code_block_6 = CodeBlock { 4; }
normalizeDepth = List.NormalizeDepth(list=pointAtParameter, rank=code_block_6)
byBestFitThroughPoints = Line.ByBestFitThroughPoints(bestFitPoints=normalizeDepth)

view_type = ViewTypesUi("AreaPlan")
getByType = archilab.Revit.Views.Views.GetByType(viewType=view_type)

# group: 5-Criar um dicionário dos esquemas de área do projeto por nível
code_block_7 = CodeBlock { "-"; }
join = String.Join(separator=code_block_7)  # unwired: string0
code_block_8 = CodeBlock { "Familia"; }
getParameterValueByName_3 = Element.GetParameterValueByName(element=getByType, parameterName=code_block_8)
id = Element.Id(element=getParameterValueByName_3)
string_from_object = FromObject(obj=id)
code_block_9 = CodeBlock { "Nivel associado"; }
getParameterValueByName_4 = Element.GetParameterValueByName(element=getByType, parameterName=code_block_9)
combine = List.Combine(comb=join, list1=string_from_object, list2=getParameterValueByName_4)

level = Custom[Element.Level](element=getByType)  # package Clockwork for Dynamo 1.x; Gets an element's level

# group: 7-Encontre visualizações de planta de área para novos limites
code_block_10 = CodeBlock { "-"; }
join_2 = String.Join(separator=code_block_10)  # unwired: string0
code_block_11 = CodeBlock { 2; }
normalizeDepth_2 = List.NormalizeDepth(list=byBestFitThroughPoints, rank=code_block_11)
count = List.Count(list=normalizeDepth_2@L1)
cycle = List.Cycle(list=uniqueItems_2, amount=count)
id_2 = Element.Id(element=cycle)
flatten_3 = List.Flatten(list=id_2)
string_from_object_2 = FromObject(obj=flatten_3)
elevation = Level.Elevation(level=level)
code_block_12 = CodeBlock { 3; }
round_2 = Math.Round(number=elevation, digits=code_block_12)
startPoint = Curve.StartPoint(curve=normalizeDepth_2)
Z = Point.Z(point=startPoint)
flatten_4 = List.Flatten(list=Z)
ꟿ_dictionary_bykeysvalues = Custom[ꟿ Dictionary.ByKeysValues](keys=round_2, values=getParameterValueByName_4, searchKeys=flatten_4)  # package spring nodes; Dictionaries are an incredibly powerful tool for making associative sets between two equal length lists. The first list must be of unique strings (or numbers) and will be the key and the second list will be the matching values (it can be made up of geometry, elements, even other lists) The search keys list will provide the corresponding value to the input key.
combine_2 = List.Combine(comb=join_2, list1=string_from_object_2, list2=ꟿ_dictionary_bykeysvalues)
ꟿ_dictionary_bykeysvalues_2 = Custom[ꟿ Dictionary.ByKeysValues](keys=combine, values=getByType, searchKeys=combine_2)

# group: 8-Encontre planos de esboço para limites
level_2 = Custom[Element.Level](element=ꟿ_dictionary_bykeysvalues_2)
plane = Custom[Level.Plane](level=level_2)  # package Clockwork for Dynamo 1.x; Retrieves the plane of a given level
plane_2 = SketchPlane.Plane(sketchPlane=plane)
flatten_5 = List.Flatten(list=plane_2)

# group: 9-Construir novos limites de separação de áreas - Remover os que se sobrepõem
flatten_6 = List.Flatten(list=byBestFitThroughPoints)
fromCurve = Custom[AreaSeparator.FromCurve](curve=flatten_6, sketchPlane=flatten_5, areaPlanView=ꟿ_dictionary_bykeysvalues_2)  # package Clockwork for Dynamo 1.x; Creates area separation lines from geometry curves.
passThrough = Custom[PassThrough](passThrough=filterByBoolMask.in, waitFor=fromCurve)  # package archi-lab.net; Ripped this off from Clockwork. Sorry Andy.

delete = archilab.Revit.Elements.Elements.Delete(element=passThrough)
